# Grasshopper definition 2.JD_setup.gh (Grasshopper 1.0.7)
# plug-ins: EleFront

# You should have saved that
# from 1.JD_SwissALTI3D.gh
pipeline = GeometryPipeline(
    GroupByLayer=False,
    GroupByType=False,
    IncludeHidden=True,
    IncludeLocked=True,
    LayerFilter="Terrain_brep",
    NameFilter="*",
    SublayerFiltering=True,
    TypeFilter=1073741848)
srfpt = SurfacePoints(Surface=pipeline)  # -> Points, Weights, Greville, UCount, VCount
pdecon = Deconstruct(Point=srfpt.Points)  # -> XComponent, YComponent, ZComponent
sort = SortList(Keys=pdecon.ZComponent, ValuesA=srfpt.Points)  # -> Keys, ValuesA
xy = XYPlane(Origin=Point(0, 0, 0))
# Highest point in terrain
item = ListItem(List=reverse(sort.ValuesA), Index=0, Wrap=True)
# Lowest point in terrain
item_2 = ListItem(List=sort.ValuesA, Index=0, Wrap=True)
pdecon_2 = Deconstruct(Point=item_2)  # -> XComponent, YComponent, ZComponent
pdecon_3 = Deconstruct(Point=item)  # -> XComponent, YComponent, ZComponent
project = Project(Geometry=pipeline, Plane=xy)  # -> Geometry, Transform
height_of_the_levels = Slider(10, range=0..100)
fmerge = MergeFaces(Brep=project.Geometry)  # -> Breps, Before, After
subtraction = Subtraction(A=pdecon_3.ZComponent, B=pdecon_2.ZComponent)
integer_division = IntegerDivision(A=subtraction, B=height_of_the_levels)
series = Series(Start=pdecon_2.ZComponent, Step=height_of_the_levels, Count=integer_division)
Z = UnitZ(Factor=series)
xy_2 = XYPlane(Origin=Point(0, 0, 0))
move = Move(Geometry=xy_2, Motion=Z)  # -> Geometry, Transform

# ----
# Press here and
# wait patiently.
dam = DataDam(DataA=pipeline, DataB=move.Geometry, BufferDelay=10000000, BufferMode=0)  # -> DataA, DataB

sec = BrepPlane(Brep=dam.DataA, Plane=dam.DataB)  # -> Curves, Points
# Bake this into Rhino!
attributes = DefineObjectAttributes(Layer="Terrain_levels")
attributes_2 = DefineObjectAttributes(Layer="Terrain_base")
bake = BakeObjects(Geometry=sec.Curves, Attributes=attributes, Bake=False)
bake_2 = BakeObjects(Geometry=fmerge.Breps, Attributes=attributes_2, Bake=False)
